# Grasshopper definition CollaborativeBake.ghx (Grasshopper 1.0.7)
# plug-ins: EleFront, Human

number_slider = Slider(10, range=1..20)
curve = Curve(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)
one_over_x = OneOverX(Value=number_slider)
series = Series(Start=0, Step=one_over_x, Count=number_slider)
evaluate_curve = EvaluateCurve(Curve=reparameterize(curve), Parameter=series)  # -> Point, Tangent, Angle
unit_z = UnitZ(Factor=1)
line_sdl = LineSDL(Start=evaluate_curve.Point, Direction=unit_z, Length=Slider(12498, range=20..20000))
loft = Loft(Curves=line_sdl, Options={Adjust=False, Closed=False, LoftEnds=0, LoftSimp=0, LoftType=0, Rebuild=10, Refit=0.01})
ghpython_script = GhPythonScript(x=loft, y=Toggle(True))  # -> out, a
# ---------- ghpython_script: Python ----------
__author__ = "csykes"
__version__ = "2023.02.03"

a = y
# ---------- end ghpython_script ----------
define_object_attributes = DefineObjectAttributes(Layer="GH")
deleteonlayer = DeleteOnLayer(Run=ghpython_script.a, Layer="GH", enableFullPath=False)
# Local inputs ▲
# Global tests ▼
bake_objects = BakeObjects(Geometry=loft, Attributes=define_object_attributes, Bake=deleteonlayer)
